# Grasshopper definition DongyubLee.gh (Grasshopper 1.0.7)

# ---- group: RH_IN:density
number_slider = Slider(60, range=50..70)

# ---- group: RH_IN:domeSize
number_slider_2 = Slider(39, range=19..59)

# ----
panel = Panel("""40
60""")
multiplication = Multiplication(A=number_slider_2, B=Slider(-1, range=-1..1))
center_box = CenterBox(Base=PlaneXY(0, 0, 0), X=number_slider_2, Y=number_slider_2, Z=number_slider_2)
unit_z = UnitZ(Factor=multiplication)
sphere = Sphere(Base=PlaneXY(0, 0, 0), Radius=number_slider_2)
move = Move(Geometry=center_box, Motion=unit_z)  # -> Geometry, Transform
geometry = Geometry(sphere)
solid_difference = SolidDifference(BrepsA=sphere, BrepsB=move.Geometry)
populate_geometry = PopulateGeometry(Geometry=geometry, Count=number_slider, Seed=Slider(36, range=0..100))
facet_dome = FacetDome(Points=populate_geometry)  # -> Pattern, Dome
pull_curve = PullCurve(Curve=facet_dome.Pattern, Surface=geometry)
trim_with_breps = TrimWithBreps(Curve=pull_curve, Brep=move.Geometry)  # -> Inside, Outside
number = Number(number_slider_2)
addition = Addition(A=number, B=Slider(0.5, range=0..5))

number_slider_3 = Slider(0.5, range=0..0.5)
curve = Curve(trim_with_breps.Outside)
pipe = Pipe(Curve=curve, Radius=number_slider_3, Caps=0)
geometry_2 = Geometry(pipe)

division = Division(A=addition, B=number)
number_2 = Number(number_slider_3)
multiplication_2 = Multiplication(A=number_2, B=Slider(0.3, range=0..1))

surface = Surface(sphere)
number_slider_4 = Slider(1.045, range=0..10)
geometry_3 = Geometry(solid_difference)
curve_2 = Curve(trim_with_breps.Outside)
scale = Scale(Geometry=geometry_3, Center=Point(0, 0, 0), Factor=division)  # -> Geometry, Transform
scale_2 = Scale(Geometry=curve_2, Center=Point(0, 0, 0), Factor=division)  # -> Geometry, Transform
deconstruct_brep = DeconstructBrep(Brep=scale.Geometry)  # -> Faces, Edges, Vertices
list_item = ListItem(List=deconstruct_brep.Edges, Index=Slider(1, range=0..10), Wrap=True)
merge = Merge(Data1=scale_2.Geometry, Data2=list_item)
pipe_2 = Pipe(Curve=merge, Radius=multiplication_2, Caps=0)
geometry_4 = Geometry(flatten(pipe_2))

# ---- group: RH_OUT:meshReinforcement
mesh = Mesh(geometry_4)

# ---- group: RH_OUT:meshSupport
mesh_2 = Mesh(geometry_2)

# ----
custom_preview = CustomPreview(
    Geometry=geometry_2,
    Material={diffuse=RGB(193, 255, 252), emission=RGB(0, 0, 0), shine=0.85, specular=RGB(217, 217, 217), transparency=0})
custom_preview_2 = CustomPreview(Geometry=geometry_4, Material=ColourSwatch(SwatchColor=RGB(255, 0, 0)))
