# Grasshopper definition LEAF.gh (Grasshopper 1.0.7)
# plug-ins: Pufferfish, LunchBox, Weaverbird, Kangaroo2 Components, Kangaroo Components

# ---- group: Formula to find radius of Hexagon
# Vegetable
panel = Panel("3")
sqrt = SquareRoot(Value=panel)
multiplication = Multiplication(A="528", B="2")
multiplication_2 = Multiplication(A=panel, B=sqrt)
division = Division(A=multiplication, B=multiplication_2)
sqrt_2 = SquareRoot(Value=division)

# Waste
panel_2 = Panel("3")
sqrt_3 = SquareRoot(Value=panel_2)
multiplication_3 = Multiplication(A="300", B="2")
multiplication_4 = Multiplication(A=panel_2, B=sqrt_3)
division_2 = Division(A=multiplication_3, B=multiplication_4)
sqrt_4 = SquareRoot(Value=division_2)

# Fish
panel_3 = Panel("3")
sqrt_5 = SquareRoot(Value=panel_3)
multiplication_5 = Multiplication(A="528", B="2")
multiplication_6 = Multiplication(A=panel_3, B=sqrt_5)
division_3 = Division(A=multiplication_5, B=multiplication_6)
sqrt_6 = SquareRoot(Value=division_3)

# Admin
panel_4 = Panel("3")
sqrt_7 = SquareRoot(Value=panel_4)
multiplication_7 = Multiplication(A="317", B="2")
multiplication_8 = Multiplication(A=panel_4, B=sqrt_7)
division_4 = Division(A=multiplication_7, B=multiplication_8)
sqrt_8 = SquareRoot(Value=division_4)

# Fungi
panel_5 = Panel("3")
sqrt_9 = SquareRoot(Value=panel_5)
multiplication_9 = Multiplication(A="528", B="2")
multiplication_10 = Multiplication(A=panel_5, B=sqrt_9)
division_5 = Division(A=multiplication_9, B=multiplication_10)
sqrt_10 = SquareRoot(Value=division_5)

# Cellular
# Agriculture
panel_6 = Panel("3")
sqrt_11 = SquareRoot(Value=panel_6)
multiplication_11 = Multiplication(A="350", B="2")
multiplication_12 = Multiplication(A=panel_6, B=sqrt_11)
division_6 = Division(A=multiplication_11, B=multiplication_12)
sqrt_12 = SquareRoot(Value=division_6)

# Insect
panel_7 = Panel("3")
sqrt_13 = SquareRoot(Value=panel_7)
multiplication_13 = Multiplication(A="528", B="2")
multiplication_14 = Multiplication(A=panel_7, B=sqrt_13)
division_7 = Division(A=multiplication_13, B=multiplication_14)
sqrt_14 = SquareRoot(Value=division_7)

# Entrance1
panel_8 = Panel("3")
sqrt_15 = SquareRoot(Value=panel_8)
multiplication_15 = Multiplication(A="200", B="2")
multiplication_16 = Multiplication(A=panel_8, B=sqrt_15)
division_8 = Division(A=multiplication_15, B=multiplication_16)
sqrt_16 = SquareRoot(Value=division_8)

# Storage
panel_9 = Panel("3")
# Calculate Program Area From Google Sheet
panel_10 = Panel("500")
sqrt_17 = SquareRoot(Value=panel_9)
multiplication_17 = Multiplication(A=panel_10, B="2")
multiplication_18 = Multiplication(A=panel_9, B=sqrt_17)
division_9 = Division(A=multiplication_17, B=multiplication_18)
sqrt_18 = SquareRoot(Value=division_9)

# Entrance2
panel_11 = Panel("3")
sqrt_19 = SquareRoot(Value=panel_11)
multiplication_19 = Multiplication(A="80", B="2")
multiplication_20 = Multiplication(A=panel_11, B=sqrt_19)
division_10 = Division(A=multiplication_19, B=multiplication_20)
sqrt_20 = SquareRoot(Value=division_10)

# Underground-Entrance
panel_12 = Panel("3")
sqrt_21 = SquareRoot(Value=panel_12)
multiplication_21 = Multiplication(A="200", B="2")
multiplication_22 = Multiplication(A=panel_12, B=sqrt_21)
division_11 = Division(A=multiplication_21, B=multiplication_22)
sqrt_22 = SquareRoot(Value=division_11)

# Life
# Supporting
panel_13 = Panel("3")
sqrt_23 = SquareRoot(Value=panel_13)
multiplication_23 = Multiplication(A="300", B="2")
multiplication_24 = Multiplication(A=panel_13, B=sqrt_23)
division_12 = Division(A=multiplication_23, B=multiplication_24)
sqrt_24 = SquareRoot(Value=division_12)

# ----
panel_14 = Panel(sqrt_18)
panel_15 = Panel(sqrt_2)
panel_16 = Panel(sqrt_10)
panel_17 = Panel(sqrt_12)
panel_18 = Panel(sqrt_14)
panel_19 = Panel(sqrt_6)
panel_20 = Panel(sqrt_4)
panel_21 = Panel(sqrt_16)
panel_22 = Panel(sqrt_20)
panel_23 = Panel(sqrt_22)
panel_24 = Panel(sqrt_8)
panel_25 = Panel(sqrt_24)
rh_in_x_coordinate = Slider(10, range=10..90)
rh_in_y_coordinate = Slider(90, range=10..90)
rh_in_rotation_variation = Slider(3, range=0..6)
rh_in_generate_inflated_inner_shell = Slider(1, range=1..2)
rh_in_outer_shell_roof_opening_size = Slider(90, range=10..90)
rh_in_generate_outer_shell = Slider(1, range=1..2)
addition = Addition(A=rh_in_generate_outer_shell, B="-2")
addition_2 = Addition(A=rh_in_generate_inflated_inner_shell, B="-2")
division_13 = Division(A=rh_in_y_coordinate, B="100")
division_14 = Division(A=rh_in_x_coordinate, B="100")
division_15 = Division(A=rh_in_outer_shell_roof_opening_size, B="100")
abs = Absolute(Value=addition)
abs_2 = Absolute(Value=addition_2)
pt = ConstructPoint(XCoordinate=division_14, YCoordinate=division_13, ZCoordinate=0)

geo = Geometry([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])
patch = Patch(Curves=geo, Spans=20, Flexibility=1, Trim=True)
evalsrf = EvaluateSurface(Surface=reparameterize(patch), Point=pt)  # -> Point, Normal, UDirection, VDirection, Frame

sph = Sphere(Base=evalsrf.Point, Radius=Slider(3, range=0..10))

# ---- group: Location
sph_2 = Sphere(Base=PlaneXY(0, 0, 0), Radius="40")
area = Area(Geometry=sph_2)  # -> Area, Centroid
move2pt = MoveToPoint(Geometry=sph_2, PointA=area.Centroid, PointB=evalsrf.Point)  # -> Moved, Vector, Transform
area_2 = Area(Geometry=move2pt.Moved)  # -> Area, Centroid
addition_3 = Addition(A="40", B="50")
cir = Circle(Plane=area_2.Centroid, Radius=addition_3)
cir_2 = Circle(Plane=area_2.Centroid, Radius="40")

# ----
mesh = MeshBrep(
    Brep=sph,
    Settings={GridMaxCount=0, GridMinCount=16, JaggedSeams=False, MaxEdgeLength=0, MinEdgeLength=0.0001, MinTolerance=0, Refine=True, RefineAngle=0, RelativeTolerance=0.65, SimplePlanes=True, Tolerance=0})
mcol = MeshColours(Mesh=mesh, Colours=ColourSwatch(SwatchColor=RGB(255, 0, 0)))

# ---- group: CONTOUR
xy = XYPlane(Origin=Point(0, 0, 0))
Z = UnitZ(Factor=1)
contour = Contour(Shape=patch, Point=xy, Direction=Z, Distance="10")
preview = CustomPreview(Geometry=contour, Material=ColourSwatch(SwatchColor=RGB(255, 255, 255)))

# ----
divide = DivideCurve(Curve=contour, Count="1", Kinks=False)  # -> Points, Tangents, Parameters
pdecon = Deconstruct(Point=divide.Points)  # -> XComponent, YComponent, ZComponent
bnd = Bounds(Numbers=flatten(pdecon.ZComponent))
remap = RemapNumbers(Value=pdecon.ZComponent, Source=bnd, Target="0 to 1")  # -> Mapped, Clipped
gradient = Gradient(LowerLimit=0, UpperLimit=1, Parameter=remap.Mapped, stops=[0: RGB(0, 128, 0), 0: RGB(95, 244, 57), 1: RGB(0, 0, 255)])
area_3 = Area(Geometry=cir_2)  # -> Area, Centroid
divide_2 = DivideCurve(Curve=cir_2, Count="6", Kinks=False)  # -> Points, Tangents, Parameters
c_script = CSharpScript(crv=[cir_2, cir], color=ColourSwatch(SwatchColor=RGB(255, 0, 0)))  # -> out, A; inputs crv: Curve, color: Color
# ---------- c_script: C# ----------
    var c = color.R + "," + color.G + "," + color.B;
    crv.SetUserString("color", c);
    A = crv;
# ---------- end c_script ----------
merge = Merge(Data2=panel_15, Data3=panel_17, Data4=panel_18, Data5=panel_19, Data6=panel_24, Data7=panel_25)  # -> simplify(graft(Result))
vec2pt = Vector2Pt(PointA=area_3.Centroid, PointB=divide_2.Points, Unitize=False)  # -> Vector, Length
merge_2 = Merge(Data1=area_3.Centroid, Data2=divide_2.Points)  # -> flatten(Result)
c_script_2 = CSharpScript(crv=contour, color=gradient)  # -> out, A; inputs crv: Curve, color: Color; same code as c_script
preview_2 = CustomPreview(Geometry=contour, Material=gradient)
addition_4 = Addition(A=panel_14, B=merge)
subtraction = Subtraction(A=addition_4, B="2")
amp = Amplitude(Vector=graft(vec2pt.Vector), Amplitude=subtraction)
move = Move(Geometry=area_3.Centroid, Motion=amp)  # -> Geometry, Transform
polygon = Polygon(Plane=simplify(graft(area_3.Centroid)), Radius=panel_14, Segments="6", FilletRadius=0)  # -> Polygon, Length
polygon_2 = Polygon(Plane=simplify(graft(move.Geometry)), Radius=merge, Segments="6", FilletRadius=0)  # -> Polygon, Length
merge_3 = Merge(Data1=flatten(polygon.Polygon), Data2=flatten(polygon_2.Polygon))  # -> graft(Result)
multiplication_25 = Multiplication(A=rh_in_rotation_variation, B="30")
rotate = Rotate(Geometry=merge_3, Angle=degrees(multiplication_25), Plane=area_3.Centroid)  # -> Geometry, Transform
srf = Surface(patch)
area_4 = Area(Geometry=rotate.Geometry)  # -> Area, Centroid
points = PointList(Points=flatten(area_4.Centroid), Size="3")
Z_2 = UnitZ(Factor=1)
rotate_2 = Rotate(Geometry=rotate.Geometry, Angle=degrees("30"), Plane=area_4.Centroid)  # -> Geometry, Transform
panel_26 = Panel("""storage
vegetable
cellular
insect
fish
admin
support""")
project = Project(Curve=rotate_2.Geometry, Brep=srf, Direction=Z_2)
disc = Discontinuity(Curve=project, Level=1)  # -> Points, Parameters
avr = Average(Input=flatten(disc.Points))
avr_2 = Average(Input=disc.Points)
pdecon_2 = Deconstruct(Point=avr_2)  # -> XComponent, YComponent, ZComponent
tag = TextTag(Location=avr_2, Text=graft(panel_26), Colour=ColourSwatch(SwatchColor=RGB(255, 255, 255)))
series = Series(Start="5", Step="5", Count="3")
subtraction_2 = Subtraction(A=pdecon_2.ZComponent, B=series)
sort = SortList(Keys=flatten(pdecon_2.ZComponent), ValuesA=flatten(avr_2))  # -> Keys, ValuesA
item = ListItem(List=sort.ValuesA, Index=0, Wrap=True)  # -> Item1, Item, Item1_2
int = Integer(sort.Keys)
item_2 = ListItem(List=int, Index=0, Wrap=True)
pl_3pt = Plane3Pt(PointA=avr, PointB=item.Item1, PointC=item.Item1_2)
subtraction_3 = Subtraction(A=item_2, B="14")
series_2 = Series(Start=subtraction_3, Step="5", Count="10")
rectangle = Rectangle(Plane=pl_3pt, XSize="-60 to 60", YSize="-60 to 60", Radius=0)  # -> Rectangle, Length
Z_3 = UnitZ(Factor=1)
roundn = RoundToNearest(NumbersX=subtraction_2, NumbersY=series_2, RemapX=False)  # -> Nearest, Index, Difference, RemappedX
sort_val = SortDuplicateValues(ValueList=flatten(roundn.Nearest))  # -> UniqueValues, Indices
project_2 = Project(Curve=project, Brep=rectangle.Rectangle, Direction=Z_3)
panel_27 = Panel(roundn.Nearest)
pt_2 = ConstructPoint(XCoordinate=pdecon_2.XComponent, YCoordinate=pdecon_2.YComponent, ZCoordinate=roundn.Nearest)
area_5 = Area(Geometry=project_2)  # -> Area, Centroid
xy_2 = XYPlane(Origin=pt_2)
project_3 = Project(Geometry=rotate_2.Geometry, Plane=xy_2)  # -> Geometry, Transform
scale = Scale(Geometry=project_2, Center=area_5.Centroid, Factor="1.03")  # -> Geometry, Transform
cull_i = CullIndex(List=project_3.Geometry, Indices="0", Wrap=True)

# ---- group: Roof
crv = Curve(scale.Geometry)

# ---- group: Floor
crv_2 = Curve(cull_i)

# ---- group: Wall
crv_3 = Curve(cull_i)

# ---- group: LEVEL
num = Number(sort_val.UniqueValues)

# ----
panel_28 = Panel(num)
item_3 = ListItem(List=crv_2, Index=0, Wrap=True)  # -> Item, Item1
srf_2 = Surface(crv_2)
Z_4 = UnitZ(Factor=".3")
merge_4 = Merge(Data1=simplify(project_2), Data2=simplify(item_3.Item1))
loft = Loft(Curves=merge_4, Options={Adjust=True, Closed=False, LoftEnds=0, LoftSimp=0, LoftType=0, Rebuild=10, Refit=0.01})
extr = Extrude(Base=srf_2, Direction=Z_4)
offsrf = OffsetSurface(Surface=loft, Distance="-.3", BothSides=False, CreateSolid=True)
mesh_2 = MeshBrep(
    Brep=extr,
    Settings={GridMaxCount=0, GridMinCount=16, JaggedSeams=False, MaxEdgeLength=0, MinEdgeLength=0.0001, MinTolerance=0, Refine=True, RefineAngle=0, RelativeTolerance=0.65, SimplePlanes=True, Tolerance=0})
area_6 = Area(Geometry=offsrf)  # -> Area, Centroid
mesh_3 = MeshBrep(
    Brep=offsrf,
    Settings={GridMaxCount=0, GridMinCount=16, JaggedSeams=False, MaxEdgeLength=0, MinEdgeLength=0.0001, MinTolerance=0, Refine=True, RefineAngle=0, RelativeTolerance=0.65, SimplePlanes=True, Tolerance=0})
swatch = ColourSwatch(SwatchColor=RGB(137, 143, 185))
bnd_2 = Bounds(Numbers=area_6.Area)
remap_2 = RemapNumbers(Value=area_6.Area, Source=bnd_2, Target="0 to 1")  # -> Mapped, Clipped
mcol_2 = MeshColours(Mesh=mesh_2, Colours=ColourSwatch(SwatchColor=RGB(134, 135, 171)))
gradient_2 = Gradient(LowerLimit=0, UpperLimit=1, Parameter=remap_2.Mapped, stops=[0: RGB(255, 255, 255), 0.956: RGB(143, 143, 158)])
mcol_3 = MeshColours(Mesh=graft(mesh_3), Colours=graft(gradient_2))

disc_2 = Discontinuity(Curve=crv, Level=1)  # -> Points, Parameters
lng = ListLength(List=disc_2.Points)
shift = ShiftList(List=disc_2.Points, Shift="1", Wrap=True)  # -> simplify(List)
shift_2 = ShiftList(List=disc_2.Points, Shift="0", Wrap=True)  # -> simplify(List)
dup = DuplicateData(Data=area_5.Centroid, Number=lng, Order=True)

# ---- group: Mesh for inflated membrane
triangle = MeshTriangle(CornerA=0, CornerB=1, CornerC=2)
merge_5 = Merge(Data1=simplify(graft(shift_2)), Data2=simplify(graft(dup)), Data3=simplify(graft(shift)))
conmesh = ConstructMesh(Vertices=merge_5, Faces=triangle)
trim = TrimTree(Tree=conmesh, Depth=1)
wbtriangles = WeaverbirdsSplitTrianglesSubdivision(MeshCurves=trim, Level="3")
wbjoin = WeaverbirdsJoinMeshesAndWeld(Mesh=flatten(wbtriangles), Weld=invert(False))
nv = NakedVertices(Mesh=wbjoin)  # -> ClothedIndex, NakedIndex, ClothedPts, NakedPts
edgelengths = EdgeLengths(Mesh=wbjoin, LengthFactor=1, Strength=1)
anchor = Anchor(Point=nv.NakedPts, Strength=Slider(400, range=0..1000))
pressure = Pressure(M=wbjoin, Strength="-.02")
pt_3 = Point(nv.NakedPts)
show = Show(G=wbjoin)
entwine = Entwine(Branch00=show, Branch01=[pressure, anchor, edgelengths], FlattenInputs=True)

# ----
filter = StreamFilter(Gate=abs_2, Stream0=entwine)

# ---- group: Inflatable
zombiesolver = ZombieSolver(GoalObjects=filter, Threshold=1e-10, Tolerance=0.01, MaxIterations=50000)  # -> I, V, O
item_4 = ListItem(List=zombiesolver.O, Index=0, Wrap=True)
demesh = DeconstructMesh(Mesh=item_4)  # -> Vertices, Faces, Colours, Normals
medges = MeshEdges(Mesh=item_4)  # -> NakedEdges, InteriorEdges, NonManifoldEdges
pdecon_3 = Deconstruct(Point=demesh.Vertices)  # -> XComponent, YComponent, ZComponent
dupln = RemoveDuplicateLines(Lines=[medges.InteriorEdges, medges.NakedEdges], Tolerance=0.01)
bnd_3 = Bounds(Numbers=pdecon_3.ZComponent)
mp = MultiPipe(Curves=dupln, NodeSize=".1", EndOffset=1, StrutSize=".2", Segment=0, KinkAngle=".2", CubeFit=0)
remap_3 = RemapNumbers(Value=pdecon_3.ZComponent, Source=bnd_3, Target="0 to 1")  # -> Mapped, Clipped
gradient_3 = Gradient(LowerLimit=0, UpperLimit=1, Parameter=remap_3.Mapped, stops=[0.14: RGB(27, 42, 255), 0.862: RGB(30, 255, 197)])
demesh_2 = DeconstructMesh(Mesh=mp)  # -> Vertices, Faces, Colours, Normals
pdecon_4 = Deconstruct(Point=demesh_2.Vertices)  # -> XComponent, YComponent, ZComponent
bnd_4 = Bounds(Numbers=pdecon_4.ZComponent)
remap_4 = RemapNumbers(Value=pdecon_4.ZComponent, Source=bnd_4, Target="0 to 1")  # -> Mapped, Clipped
mcol_4 = MeshColours(Mesh=item_4, Colours=gradient_3)
gradient_4 = Gradient(
    LowerLimit=0,
    UpperLimit=1,
    Parameter=remap_4.Mapped,
    stops=[0: RGB(255, 105, 0), 0.5: RGB(255, 255, 0), 1: RGB(255, 0, 0)])
mcol_5 = MeshColours(Mesh=mp, Colours=gradient_4)

# ----
panel_29 = Panel(gradient)
medges_2 = MeshEdges(Mesh=mcol_5)  # -> NakedEdges, InteriorEdges, NonManifoldEdges

# ---- group: RH_OUT: Wall
mesh_4 = Mesh(mcol_3)

# ---- group: RH_OUT: Contours
crv_4 = Curve(c_script_2.A)

# ---- group: RH_OUT: Floor
mesh_5 = Mesh(mcol_2)

# ---- group: RH_OUT: Inflated Membrane
mesh_6 = Mesh(mcol_4)

# ---- group: RH_OUT: Boundary
crv_5 = Curve(c_script.A)

# ---- group: RH_OUT: Inflated Structure
mesh_7 = Mesh(mcol_5)

# ---- group: RH_OUT: Location
mesh_8 = Mesh(mcol)

# ----
crv_6 = Curve(scale.Geometry)
Z_5 = UnitZ(Factor="8")
dom²num = ConstructDomain²(UMin=Slider(0, range=0..1), UMax=Slider(1, range=0..1), VMin=Slider(0, range=0..1), VMax=division_15)
triangle_2 = MeshTriangle(CornerA=0, CornerB=1, CornerC=2)

filter_2 = StreamFilter(Gate=abs, Stream0=crv_6)

disc_3 = Discontinuity(Curve=filter_2, Level=1)  # -> Points, Parameters
area_7 = Area(Geometry=filter_2)  # -> Area, Centroid
pt_4 = Point(disc_3.Points)
move_2 = Move(Geometry=area_7.Centroid, Motion=Z_5)  # -> Geometry, Transform
lng_2 = ListLength(List=pt_4)
pdecon_5 = Deconstruct(Point=pt_4)  # -> XComponent, YComponent, ZComponent
pdecon_6 = Deconstruct(Point=move_2.Geometry)  # -> XComponent, YComponent, ZComponent
dup_2 = DuplicateData(Data=move_2.Geometry, Number=lng_2, Order=True)
pt_5 = ConstructPoint(XCoordinate=pdecon_5.XComponent, YCoordinate=pdecon_5.YComponent, ZCoordinate=pdecon_6.ZComponent)
merge_6 = Merge(Data1=simplify(graft(pt_4)), Data2=simplify(graft(pt_5)), Data3=simplify(graft(dup_2)))
nurbs = NurbsCurve(Vertices=merge_6, Degree="2", Periodic=False)  # -> Curve, Length, Domain
trim_2 = TrimTree(Tree=nurbs.Curve, Depth=1)
shift_3 = ShiftList(List=trim_2, Shift="1", Wrap=True)
shift_4 = ShiftList(List=trim_2, Shift="0", Wrap=True)
merge_7 = Merge(Data1=simplify(graft(shift_4)), Data2=simplify(graft(shift_3)))
loft_2 = Loft(Curves=merge_7, Options={Adjust=False, Closed=False, LoftEnds=0, LoftSimp=0, LoftType=0, Rebuild=10, Refit=0.01})
trim_3 = TrimTree(Tree=loft_2, Depth=1)
subsrf = Isotrim(Surface=reparameterize(loft_2), Domain=dom²num)
trib = TrianglePanelsB(Surface=subsrf, UDivisions="6", VDivisions="6")
debrep = DeconstructBrep(Brep=flatten(trib))  # -> Faces, Edges, Vertices
clean = CleanTree(RemoveNulls=True, RemoveInvalid=True, RemoveEmpty=invert(False), Tree=debrep.Vertices)
conmesh_2 = ConstructMesh(Vertices=simplify(clean), Faces=triangle_2)
wbjoin_2 = WeaverbirdsJoinMeshesAndWeld(Mesh=flatten(conmesh_2), Weld=True)
wbdual = WeaverbirdsDualGraph(MeshCurves=wbjoin_2, DualMode=0)
disc_4 = Discontinuity(Curve=wbdual, Level=1)  # -> Points, Parameters
lng_3 = ListLength(List=disc_4.Points)  # -> flatten(Length)
equals = Equality(FirstNumber=lng_3, SecondNumber="6")  # -> Equality, Inequality
dispatch = Dispatch(List=wbdual, DispatchPattern=equals.Equality)  # -> ListA, ListB
crv_7 = Curve(dispatch.ListB)
crv_8 = Curve(dispatch.ListA)
disc_5 = Discontinuity(Curve=crv_8, Level=1)  # -> Points, Parameters
plfit = PlaneFit(Points=disc_5.Points)  # -> Plane, Deviation
project_4 = Project(Geometry=graft(crv_8), Plane=plfit.Plane)  # -> Geometry, Transform
area_8 = Area(Geometry=flatten(project_4.Geometry))  # -> Area, Centroid
srf_3 = Surface(project_4.Geometry)
mesh_9 = MeshBrep(
    Brep=srf_3,
    Settings={GridMaxCount=0, GridMinCount=16, JaggedSeams=False, MaxEdgeLength=0, MinEdgeLength=0.0001, MinTolerance=0, Refine=True, RefineAngle=0, RelativeTolerance=0.65, SimplePlanes=True, Tolerance=0})
bnd_5 = Bounds(Numbers=area_8.Area)
remap_5 = RemapNumbers(Value=area_8.Area, Source=bnd_5, Target="0 to 1")  # -> graft(Mapped), Clipped
gradient_5 = Gradient(
    LowerLimit=0,
    UpperLimit=1,
    Parameter=remap_5.Mapped,
    stops=[0: RGB(243, 57, 0), 0.1: RGB(236, 27, 60), 0.2: RGB(210, 0, 118), 0.3: RGB(103, 0, 120), 0.4: RGB(39, 72, 161), 0.5: RGB(1, 192, 229), 0.6: RGB(18, 178, 90), 0.7: RGB(79, 186, 8), 0.8: RGB(220, 237, 32), 0.9: RGB(247, 159, 20), 1: RGB(243, 57, 0)])
mcol_6 = MeshColours(Mesh=mesh_9, Colours=gradient_5)

disc_6 = Discontinuity(Curve=project_4.Geometry, Level=1)  # -> Points, Parameters

# ---- group: RH_OUT: Outer Shell
mesh_10 = Mesh(mcol_6)
